# Grasshopper definition selfie_script.ghx (Grasshopper 0.9.69)

path = FilePath("C:\Users\Kevyn\Documents\Processing\sketch_140211a\fuelbandScraper\fuelBandDataWriter\onlineData.txt")
path_2 = FilePath("C:\Users\Kevyn\Documents\Processing\sketch_140211a\fuelbandScraper\fuelBandDataWriter\fuelData.txt")
file = ReadFile(File=path, PerLineParse=True)
file_2 = ReadFile(File=path_2, PerLineParse=True)
path_3 = FilePath("C:\Users\Kevyn\Documents\Processing\sketch_140211a\fuelbandScraper\fuelBandDataWriter\fuelData.txt")
split = TextSplit(Text=file, Separators=",")
num = Number(split)
split_2 = TextSplit(Text=file_2, Separators=",")
length = Slider(46, range=0..100)  # disabled
file_3 = ReadFile(File=path_3, PerLineParse=True)
number_slider = Slider(24, range=0..100)  # disabled
number_slider_2 = Slider(0, range=0..100)  # disabled
bang = ExplodeTree(Data=split_2)  # -> Branch0, Branch1, Branch2, Branch3, Branch4, Branch5, Branch6, Branch7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
num_2 = Number(split)
number_slider_3 = Slider(2, range=0..100)  # disabled
division = Division(A=number_slider, B=length)  # disabled
split_3 = TextSplit(Text=file_3, Separators=",")
number_slider_4 = Slider(5, range=0..100)  # disabled
girth = Slider(0.5, range=0..10)  # disabled
path_4 = FilePath("C:\Users\Kevyn\Documents\Processing\sketch_140211a\fuelbandScraper\fuelBandDataWriter\redditData.txt")  # disabled
series = Series(Start=number_slider_2, Step=division, Count=number_slider)  # disabled
sort = SortList(Keys=num_2)  # -> Keys, ValuesA
bang_2 = ExplodeTree(Data=split_3)  # -> Branch0, Branch1, Branch2, Branch3, Branch4, Branch5, Branch6, Branch7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
panel = Panel(",")  # disabled
file_4 = ReadFile(File=path_4, PerLineParse=True)  # disabled
series_2 = Series(Start=0, Step=number_slider_3, Count=number_slider_4)  # disabled
cir = Circle(Plane=PlaneXY(0, 0, 0), Radius=girth)  # disabled
item = ListItem(List=sort.Keys, Index=0, Wrap=True)
item_2 = ListItem(List=sort.Keys, Index=Slider(19, range=0..100), Wrap=True)
Z = UnitZ(Factor=series)  # disabled
dom = ConstructDomain(DomainStart=Slider(150, range=0..10000), DomainEnd=Slider(400, range=0..10000))
dom_2 = ConstructDomain(DomainStart=Slider(3500, range=0..10000), DomainEnd=Slider(7000, range=0..10000))
dom_3 = ConstructDomain(DomainStart=Slider(350, range=0..10000), DomainEnd=Slider(700, range=0..10000))
dom_4 = ConstructDomain(DomainStart=Slider(800, range=0..10000), DomainEnd=Slider(1500, range=0..10000))
X = UnitX(Factor=series_2)  # disabled
number_slider_5 = Slider(60, range=0..100)  # disabled
dom_5 = ConstructDomain(DomainStart=item, DomainEnd=item_2)
move = Move(Geometry=cir, Motion=Z)  # -> Geometry, Transform; disabled
move_2 = Move(Geometry=graft(move.Geometry), Motion=X)  # -> Geometry, Transform; disabled
split_4 = TextSplit(Text=file_4, Separators=panel)  # disabled
number_slider_6 = Slider(9.3, range=0..20)  # disabled
merge = Merge(Data1=dom_4, Data2=dom_2, Data3=dom, Data4=dom_3)  # -> graft(Result)
bang_3 = ExplodeTree(Data=split_4)  # -> Branch0, Branch1; disabled
number_slider_7 = Slider(40, range=0..100)  # disabled
remap = RemapNumbers(Value=num_2, Source=dom_5, Target=merge)  # -> Mapped, Clipped
number_slider_8 = Slider(9.3, range=0..20)  # disabled
area = Area(Geometry=move.Geometry)  # -> Area, Centroid; disabled
number_slider_9 = Slider(5, range=0..10)
crv = Curve(<curve referenced from the Rhino model>)
divide = DivideCurve(Curve=move.Geometry, Count=number_slider_5, Kinks=False)  # -> Points, Tangents, Parameters; disabled
bang_4 = ExplodeTree(Data=remap.Mapped)  # -> Branch0, Branch1, Branch2, Branch3
number_slider_10 = Slider(40, range=0..100)  # disabled
item_3 = ListItem(List=area.Centroid, Index=0, Wrap=True)  # disabled
number_slider_11 = Slider(0.5, range=0..1)  # disabled
cir_2 = Circle(Plane=PlaneXY(0, 0, 0), Radius=Slider(4, range=0..10))
partition = PartitionList(List=flatten(divide.Points), Size=number_slider_5)  # disabled
number_slider_12 = Slider(1, range=0..10)  # disabled
explode = Explode(Curve=crv, Recursive=True)  # -> Segments, Vertices
number_slider_13 = Slider(0.09, range=0..1)  # disabled
addition = Addition(A=number_slider_9, B=1)
int = Integer(bang_2.Branch13)
bang_5 = ExplodeTree(Data=graft(bang_4.Branch0))  # -> _0000, _0001, _0002, _0003, _0004, _0005, _0006, _0007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
bang_6 = ExplodeTree(Data=graft(bang_4.Branch1))  # -> _0010, _0011, _0012, _0013, _0014, _0015, _0016, _0017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
bang_7 = ExplodeTree(Data=graft(bang_4.Branch2))  # -> _0020, _0021, _0022, _0023, _0024, _0025, _0026, _0027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
bang_8 = ExplodeTree(Data=graft(bang_4.Branch3))  # -> _0030, _0031, _0032, _0033, _0034, _0035, _0036, _0037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
addition_2 = Addition(A=bang_3.Branch0, B=bang_3.Branch1)  # disabled
sort_2 = SortList(Keys=addition_2)  # -> Keys, ValuesA; disabled
pt = Point(area.Centroid)  # disabled
vec2pt = Vector2Pt(PointA=graft(area.Centroid), PointB=partition, Unitize=False)  # -> Vector, Length; disabled
pipe = Pipe(Curve=cir_2, Radius=1, Caps=2)
divide_2 = DivideCurve(Curve=explode.Segments, Count=number_slider_9, Kinks=False)  # -> Points, Tangents, Parameters
subtraction = Subtraction(A=girth, B=number_slider_13)  # disabled
number_slider_14 = Slider(0.15, range=0..1)  # disabled
bang_9 = ExplodeTree(Data=divide_2.Points)  # -> Branch0, Branch1, Branch2, Branch3
cir_3 = Circle(Plane=PlaneXY(0, 0, 0), Radius=number_slider_12)  # disabled
divide_3 = DivideCurve(Curve=cir_2, Count=Slider(24, range=0..100), Kinks=False)  # -> Points, Tangents, Parameters
division_2 = Division(A=int, B=number_slider_10)  # disabled
lng = ListLength(List=sort_2.Keys)  # disabled
amp = Amplitude(Vector=flatten(vec2pt.Vector), Amplitude=division_2)  # disabled
vdis = VectorDisplay(Anchor=graft(area.Centroid), Vector=vec2pt.Vector)  # disabled
rev = Reverse(Vector=flatten(vec2pt.Vector))  # disabled
lng_2 = ListLength(List=bang_9.Branch0)
pl = PlaneNormal(Origin=divide_3.Points, ZAxis=divide_3.Tangents)
subtraction_2 = Subtraction(A=lng, B=1)  # disabled
move_3 = Move(Geometry=flatten(partition), Motion=amp)  # -> Geometry, Transform; disabled
number_slider_15 = Slider(24, range=0..100)  # disabled
pipe_2 = Pipe(Curve=cir_3, Radius=subtraction, Caps=2)  # disabled
pipe_3 = Pipe(Curve=cir_3, Radius=number_slider_11, Caps=2)  # disabled
amp_2 = Amplitude(Vector=rev, Amplitude=number_slider_14)  # disabled
item_4 = ListItem(List=sort_2.Keys, Index=subtraction_2, Wrap=True)  # disabled
item_5 = ListItem(List=sort_2.Keys, Index=0, Wrap=True)  # disabled
item_6 = ListItem(List=pl, Index=0, Wrap=True)
division_3 = Division(A=lng_2, B=addition)
number_slider_16 = Slider(0.5, range=0..1)  # disabled
item_7 = ListItem(List=divide_3.Points, Index=0, Wrap=True)
divide_4 = DivideCurve(Curve=cir_3, Count=number_slider_15, Kinks=False)  # -> Points, Tangents, Parameters; disabled
align = AlignPlanes(Planes=pl, Master=item_6)
num_3 = Number(bang_6._00113)
num_4 = Number(bang_7._00213)
num_5 = Number(bang_5._00013)
num_6 = Number(bang_8._00313)
move_4 = Move(Geometry=move_3.Geometry, Motion=amp_2)  # -> Geometry, Transform; disabled
dom_6 = ConstructDomain(DomainStart=item_5, DomainEnd=item_4)  # disabled
addition_3 = Addition(A=division_3, B=1)
partition_2 = PartitionList(List=move_3.Geometry, Size=number_slider_5)  # disabled
pl_2 = PlaneNormal(Origin=divide_4.Points, ZAxis=divide_4.Tangents)  # disabled
sec = BrepPlane(Brep=pipe, Plane=align)  # -> Curves, Points
number_slider_17 = Slider(1.2, range=0..10)  # disabled
xy = XYPlane(Origin=area.Centroid)  # disabled
toggle = BooleanToggle(True)  # disabled
series_3 = Series(Start=0, Step=number_slider_9, Count=addition_3)
partition_3 = PartitionList(List=move_4.Geometry, Size=number_slider_5)  # disabled
intcrv = Interpolate(Vertices=partition_2, Degree=3, Periodic=True, KnotStyle=1)  # -> Curve, Length, Domain; disabled
item_8 = ListItem(List=pl_2, Index=0, Wrap=True)  # disabled
cull_i = CullIndex(List=divide_2.Points, Indices=series_3, Wrap=True)
dom_7 = ConstructDomain(DomainStart=number_slider_16, DomainEnd=number_slider_17)  # disabled
partition_4 = PartitionList(List=sec.Curves, Size=Slider(24, range=0..100))
item_9 = ListItem(List=divide_4.Points, Index=0, Wrap=True)  # disabled
dispatch = Dispatch(List=divide_2.Points, DispatchPattern=[True, False])  # -> ListA, ListB
nurbs = NurbsCurve(Vertices=partition_2, Degree=3, Periodic=True)  # -> Curve, Length, Domain; disabled
pt_2 = Point(flatten(cull_i))
pline = PolyLine(Vertices=partition_2, Closed=toggle)  # -> flatten(Polyline); disabled
remap_2 = RemapNumbers(Value=addition_2, Source=dom_6, Target=dom_7)  # -> Mapped, Clipped; disabled
cls = Closed(Curve=partition_4)  # -> Closed, Periodic
pline_2 = PolyLine(Vertices=partition_3, Closed=toggle)  # -> flatten(Polyline); disabled
number_slider_18 = Slider(90, range=0..360)  # disabled
bang_10 = ExplodeTree(Data=partition_4)  # -> _00000, _00010
parc = PolyArc(Vertices=partition_2, Closed=toggle)  # disabled
number_slider_19 = Slider(0, range=0..19)  # disabled
number_slider_20 = Slider(60, range=0..100)
rev_2 = ReverseList(List=pt_2)
path_5 = FilePath("C:\Users\Kevyn\Documents\Processing\sketch_140211a\fuelbandScraper\fuelBandDataWriter\fuelData.txt")
align_2 = AlignPlanes(Planes=pl_2, Master=item_8)  # disabled
file_5 = ReadFile(File=path_5, PerLineParse=True)
ln = Line(StartPoint=pt_2, EndPoint=rev_2)
number_slider_21 = Slider(60, range=0..100)  # disabled
number_slider_22 = Slider(24, range=0..100)  # disabled
prot = RotatePlane(Plane=align_2, Angle=number_slider_18)  # disabled
divide_5 = DivideCurve(Curve=bang_10._00000, Count=number_slider_20, Kinks=False)  # -> Points, Tangents, Parameters
number_slider_23 = Slider(20, range=0..100)  # disabled
number_slider_24 = Slider(5, range=0..100)  # disabled
orient = Orient(Geometry=pline, Source=xy, Target=prot)  # -> Geometry, Transform; disabled
split_5 = TextSplit(Text=file_5, Separators=",")
srf = Surface(<surface referenced from the Rhino model>)  # disabled
partition_5 = PartitionList(List=flatten(divide_5.Points), Size=number_slider_20)
item_10 = ListItem(List=remap_2.Mapped, Index=number_slider_19, Wrap=True)  # disabled
orient_2 = Orient(Geometry=pline_2, Source=xy, Target=prot)  # -> Geometry, Transform; disabled
divide_6 = DivideDomain²(Domain=srf, UCount=number_slider_22, VCount=number_slider_21)  # disabled
srf_2 = Surface(<surface referenced from the Rhino model>)  # disabled
bang_11 = ExplodeTree(Data=split_5)  # -> Branch0, Branch1, Branch2, Branch3, Branch4, Branch5, Branch6, Branch7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
loft = Loft(
    Curves=orient.Geometry,
    Options={Adjust=False, Closed=False, LoftEnds=0, LoftSimp=1, LoftType=1, Rebuild=1000, Refit=0.01})  # disabled
divide_7 = DivideDomain²(Domain=srf_2, UCount=number_slider_24, VCount=number_slider_23)  # disabled
partition_6 = PartitionList(List=divide_6, Size=number_slider_21)  # disabled
cap = CapHoles(Brep=loft)  # disabled
loft_2 = Loft(
    Curves=orient_2.Geometry,
    Options={Adjust=False, Closed=False, LoftEnds=0, LoftSimp=1, LoftType=1, Rebuild=1000, Refit=0.01})  # disabled
int_2 = Integer(bang_11.Branch0)
partition_7 = PartitionList(List=divide_7, Size=number_slider_23)  # disabled
vec2pt_2 = Vector2Pt(PointA=graft(divide_3.Points), PointB=partition_5, Unitize=False)  # -> Vector, Length
flip = FlipMatrix(Data=partition_6)  # -> flatten(Data); disabled
pt_3 = Point(graft(divide_3.Points))
division_4 = Division(A=int_2, B=Slider(5.6, range=0..10))
flip_2 = FlipMatrix(Data=partition_7)  # -> flatten(Data); disabled
amp_3 = Amplitude(Vector=flatten(vec2pt_2.Vector), Amplitude=division_4)
cap_2 = CapHoles(Brep=loft_2)  # disabled
bang_12 = ExplodeTree(Data=pt_3)  # -> Branch0, Branch1
crv_cp = CurveClosestPoint()  # -> Point, Parameter, Distance
bang_13 = ExplodeTree(Data=partition_5)  # -> Branch0, Branch1
subsrf = Isotrim(Surface=srf, Domain=flatten(flip))  # disabled
volume = Volume()  # -> Volume, Centroid; disabled
bang_14 = ExplodeTree(Data=split_2)  # -> Branch0, Branch1, Branch2, Branch3, Branch4, Branch5, Branch6, Branch7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
bbox = BoundingBox(Content=pipe_2, Plane=PlaneXY(0, 0, 0))  # -> Box, Box_2; disabled
subsrf_2 = Isotrim(Surface=srf_2, Domain=flatten(flip_2))  # disabled
number_slider_25 = Slider(14, range=0..1000)  # disabled
move_5 = Move(Geometry=flatten(partition_5), Motion=amp_3)  # -> Geometry, Transform
vdis_2 = VectorDisplay(Anchor=graft(divide_3.Points), Vector=vec2pt_2.Vector)
pt_4 = Point(bang_12.Branch0)
volume_2 = Volume(Geometry=bbox.Box)  # -> Volume, Centroid; disabled
number_slider_26 = Slider(14, range=0..1000)  # disabled
pt_5 = Point(bang_13.Branch0)
area_2 = Area(Geometry=subsrf)  # -> Area, Centroid; disabled
goal_day_online_usage = Slider(29, range=0..29)

# ----
# Online Data Remaping
sort_3 = SortList(Keys=num)  # -> Keys, ValuesA
item_11 = ListItem(List=sort_3.Keys, Index=0, Wrap=True)
item_12 = ListItem(List=sort_3.Keys, Index=Slider(32, range=0..100), Wrap=True)
dom_8 = ConstructDomain(DomainStart=Slider(0.063, range=0..1), DomainEnd=Slider(0.15, range=0..1))
dom_9 = ConstructDomain(DomainStart=item_11, DomainEnd=item_12)
remap_3 = RemapNumbers(Value=num, Source=dom_9, Target=dom_8)  # -> Mapped, Clipped
item_13 = ListItem(List=remap_3.Mapped, Index=goal_day_online_usage, Wrap=True)
num_7 = Number(item_13)

int_3 = Integer(reverse(bang_14.Branch29))

# ----
# Fuel Data Remaping
partition_8 = PartitionList(List=int_3, Size=Slider(60, range=0..100))
ma = MassAddition(Input=partition_8)  # -> flatten(Result), PartialResults
sort_4 = SortList(Keys=ma.Result)  # -> Keys, ValuesA
lng_3 = ListLength(List=sort_4.Keys)
subtraction_3 = Subtraction(A=lng_3, B=1)
item_14 = ListItem(List=sort_4.Keys, Index=0, Wrap=True)
item_15 = ListItem(List=sort_4.Keys, Index=subtraction_3, Wrap=True)
dom_10 = ConstructDomain(DomainStart=item_14, DomainEnd=item_15)
dom_11 = ConstructDomain(DomainStart=Slider(0, range=0..100), DomainEnd=Slider(0.6, range=0..1))
remap_4 = RemapNumbers(Value=ma.Result, Source=dom_10, Target=dom_11)  # -> Mapped, Clipped

number_slider_27 = Slider(3, range=0..10)
series_4 = Series(Start=Slider(0.01, range=0..0.01), Step=Slider(0.06, range=0..0.1), Count=number_slider_27)
series_5 = Series(Start=Slider(0, range=0..100), Step=num_7, Count=number_slider_27)
subtraction_4 = Subtraction(A=number_slider_27, B=1)
cir_4 = Circle(Plane=PlaneXY(0, 0, 0), Radius=series_4)
Z_2 = UnitZ(Factor=series_5)
# Handle and Body Geometry
move_6 = Move(Geometry=cir_4, Motion=Z_2)  # -> Geometry, Transform
item_16 = ListItem(List=series_5, Index=subtraction_4, Wrap=True)
number_slider_28 = Slider(0.063, range=0..1)
number_slider_29 = Slider(24, range=0..100)
addition_4 = Addition(A=remap_4.Mapped, B=number_slider_28)
series_6 = Series(Start=item_16, Step=num_7, Count=number_slider_29)
subtraction_5 = Subtraction(A=number_slider_29, B=1)
cir_5 = Circle(Plane=PlaneXY(0, 0, 0), Radius=addition_4)
item_17 = ListItem(List=series_6, Index=subtraction_5, Wrap=True)
addition_5 = Addition(A=item_17, B=num_7)
series_7 = Series(Start=addition_5, Step=Slider(0.33, range=0..1), Count=Slider(3, range=0..10))
cir_6 = Circle(Plane=PlaneXY(0, 0, 0), Radius=number_slider_28)
Z_3 = UnitZ(Factor=series_7)
Z_4 = UnitZ(Factor=series_6)
move_7 = Move(Geometry=cir_6, Motion=Z_3)  # -> Geometry, Transform
move_8 = Move(Geometry=cir_5, Motion=Z_4)  # -> Geometry, Transform
lng_4 = ListLength(List=move_7.Geometry)
subtraction_6 = Subtraction(A=lng_4, B=Slider(1, range=0..1))
item_18 = ListItem(List=move_7.Geometry, Index=subtraction_6, Wrap=True)
merge_2 = Merge(Data1=move_6.Geometry, Data2=move_8.Geometry, Data3=move_7.Geometry)  # -> flatten(Result)
area_3 = Area(Geometry=item_18)  # -> Area, Centroid
loft_3 = Loft(Curves=merge_2, Options={Adjust=False, Closed=False, LoftEnds=0, LoftSimp=1, LoftType=1, Rebuild=100, Refit=0.01})
xy_2 = XYPlane(Origin=area_3.Centroid)
cap_3 = CapHoles(Brep=loft_3)
sph = Sphere(Base=xy_2, Radius=Slider(0.09, range=0..0.1))
sph_2 = Sphere(Base=PlaneXY(0, 0, 0), Radius=Slider(0.01, range=0..0.1))

# ----
# Fuel Data Parsing (to find goal achievement)
number_slider_30 = Slider(23, range=0..100)
path_6 = FilePath("C:\Users\Kevyn\Documents\Processing\sketch_140211a\fuelbandScraper\fuelBandDataWriter\goals.txt")
file_6 = ReadFile(File=path_6, PerLineParse=True)
split_6 = TextSplit(Text=file_6, Separators=",")
dom_12 = ConstructDomain(DomainStart=Slider(0, range=0..100), DomainEnd=Slider(1399, range=0..10000))
dom_13 = ConstructDomain(DomainStart=Slider(0, range=0..100), DomainEnd=number_slider_30)
remap_5 = RemapNumbers(Value=split_6, Source=dom_12, Target=dom_13)  # -> Mapped, Clipped
subtraction_7 = Subtraction(A=remap_5.Mapped, B=23)
abs = Absolute(Value=subtraction_7)
item_19 = ListItem(List=abs, Index=goal_day_online_usage, Wrap=True)
smaller = SmallerThan(FirstNumber=item_19, SecondNumber=Slider(23, range=0..100))  # -> SmallerThan, OrEqualTo
item_20 = ListItem(List=move_8.Geometry, Index=item_19, Wrap=True)
not = GateNot(A=smaller.SmallerThan)
merge_3 = Merge(Data1=not, Data2=smaller.SmallerThan)
merge_4 = Merge(Data1=Slider(0, range=0..100), Data2=Slider(0.05, range=0..1))
cull = CullPattern(List=merge_4, CullPattern=merge_3)

# ----
# Pin Geometry
offset = Offset(Curve=item_20, Distance=Slider(0.05, range=0..0.1), Plane=PlaneXY(0, 0, 0), Corners=1)
divide_8 = DivideCurve(Curve=offset, Count=Slider(20, range=0..100), Kinks=False)  # -> Points, Tangents, Parameters
xy_3 = XYPlane(Origin=divide_8.Points)
sph_3 = Sphere(Base=xy_3, Radius=cull)

# ----
# Output Geo Logic
merge_5 = Merge(Data1=cap_3, Data2=sph_2, Data3=sph)  # -> flatten(Result)
sunion = SolidUnion(Breps=merge_5)
sdiff = SolidDifference(BrepsA=sunion, BrepsB=sph_3)
merge_6 = Merge(Data1=sunion, Data2=sdiff)  # -> flatten(Result)
cull_2 = CullPattern(List=merge_6, CullPattern=merge_3)

brep = Brep(cull_2)
loft_4 = Loft(
    Curves=flatten(nurbs.Curve),
    Options={Adjust=False, Closed=False, LoftEnds=0, LoftSimp=1, LoftType=0, Rebuild=1000, Refit=0.01})  # disabled
sdiff_2 = SolidDifference(BrepsA=cap, BrepsB=pipe_2)  # disabled
panel_2 = Panel(pt_3)
partition_9 = PartitionList(List=int_3, Size=number_slider_25)  # disabled
area_4 = Area(Geometry=subsrf_2)  # -> Area, Centroid; disabled
partition_10 = PartitionList(List=move_5.Geometry, Size=Slider(60, range=0..100))
srf_cp = SurfaceClosestPoint(Point=area_2.Centroid, Surface=subsrf)  # -> Point, UVPoint, Distance; disabled
partition_11 = PartitionList(List=int_3, Size=number_slider_26)  # disabled
scale = Scale(Geometry=sdiff_2, Center=volume_2.Centroid, Factor=item_10)  # -> Geometry, Transform
srf_cp_2 = SurfaceClosestPoint(Point=area_4.Centroid, Surface=subsrf_2)  # -> Point, UVPoint, Distance; disabled
pline_3 = PolyLine(Vertices=partition_10, Closed=False)
number_slider_31 = Slider(3, range=0..10)  # disabled
number_slider_32 = Slider(0.008, range=0..1)  # disabled
panel_3 = Panel("""14
8
3
12
19
5
10""")
ma_2 = MassAddition(Input=partition_9)  # -> flatten(Result), PartialResults; disabled
evalsrf = EvaluateSurface(Surface=subsrf, Point=srf_cp.UVPoint)  # -> Point, Normal, Frame; disabled
number_slider_33 = Slider(3, range=0..10)  # disabled
number_slider_34 = Slider(0.025, range=0..1)  # disabled
ma_3 = MassAddition(Input=partition_11)  # -> flatten(Result), PartialResults; disabled
evalsrf_2 = EvaluateSurface(Surface=subsrf_2, Point=srf_cp_2.UVPoint)  # -> Point, Normal, Frame; disabled
pl_3 = PlaneNormal(Origin=evalsrf.Point, ZAxis=evalsrf.Normal)  # disabled
number_slider_35 = Slider(0, range=0..10)  # disabled
number_slider_36 = Slider(0.03, range=0..0.05)  # disabled
number_slider_37 = Slider(0.04, range=0..0.1)  # disabled
series_8 = Series(Start=0, Step=1, Count=number_slider_31)  # disabled
number_slider_38 = Slider(0.01, range=0..0.01)  # disabled
pl_4 = PlaneNormal(Origin=evalsrf_2.Point, ZAxis=evalsrf_2.Normal)  # disabled
number_slider_39 = Slider(0, range=0..10)  # disabled
cir_7 = Circle(Plane=pl_3, Radius=number_slider_32)  # disabled
number_slider_40 = Slider(0.008, range=0..0.1)  # disabled
number_slider_41 = Slider(0.03, range=0..0.05)  # disabled
number_slider_42 = Slider(0.04, range=0..0.1)  # disabled
division_5 = Division(A=int_3, B=num_6)  # disabled
division_6 = Division(A=int_3, B=num_4)  # disabled
series_9 = Series(Start=0, Step=1, Count=number_slider_33)  # disabled
number_slider_43 = Slider(0.01, range=0..0.01)  # disabled
cull_i_2 = CullIndex(List=ma_2.Result, Indices=series_8, Wrap=True)  # disabled
cir_8 = Circle(Plane=pl_4, Radius=number_slider_34)  # disabled
number_slider_44 = Slider(0.02, range=0..0.1)  # disabled
addition_6 = Addition(A=division_6, B=number_slider_37)  # disabled
cull_i_3 = CullIndex(List=ma_3.Result, Indices=series_9, Wrap=True)  # disabled
division_7 = Division(A=cull_i_3, B=num_3)  # disabled
division_8 = Division(A=cull_i_3, B=num_5)  # disabled
amp_4 = Amplitude(Vector=pl_3, Amplitude=number_slider_36)  # disabled
amp_5 = Amplitude(Vector=evalsrf.Normal, Amplitude=addition_6)  # disabled
addition_7 = Addition(A=division_5, B=number_slider_40)  # disabled
addition_8 = Addition(A=division_8, B=number_slider_42)  # disabled
amp_6 = Amplitude(Vector=pl_4, Amplitude=number_slider_41)  # disabled
amp_7 = Amplitude(Vector=evalsrf_2.Normal, Amplitude=addition_8)  # disabled
addition_9 = Addition(A=division_7, B=number_slider_44)  # disabled
move_9 = Move(Geometry=cir_7, Motion=amp_4)  # -> Geometry, Transform; disabled
rev_3 = Reverse(Vector=amp_5)  # disabled
move_10 = Move(Geometry=cir_8, Motion=amp_6)  # -> Geometry, Transform; disabled
rev_4 = Reverse(Vector=amp_7)  # disabled
extr = Extrude(Base=move_9.Geometry, Direction=rev_3)  # disabled
sph_4 = Sphere(Base=cir_8, Radius=addition_9)  # disabled
extr_2 = Extrude(Base=move_10.Geometry, Direction=rev_4)  # disabled
cap_4 = CapHoles(Brep=extr)  # disabled
sph_5 = Sphere(Base=cir_7, Radius=addition_7)  # disabled
cap_5 = CapHoles(Brep=extr_2)  # disabled
